# Grasshopper definition sectiondrawer.gh (Grasshopper 0.9.76)
# plug-ins: Python Interpreter

reversesection = BooleanToggle(True)
marksize = Slider(6, range=0..100)
redo = Button()
nextsection = Button()
startdraw = BooleanToggle(True)
reset = Button()

# ---- group: 切断線
crv = Curve(reparameterize([<curve referenced from the Rhino model> x2]))

# ----
curvepoint = PointOnCurve(crv, parameter=0.5)
sort_pt = SortPoints(Points=curvepoint)  # -> Points, Indices
item = ListItem(List=crv, Index=sort_pt.Indices, Wrap=True)
crv_2 = Curve(item)
lng = ListLength(List=crv_2)
file = ReadFile(File="D:\python\sectiondrawer\sectiondrawer\sectiondrawer.py", PerLineParse=False)
end = EndPoints(Curve=crv_2)  # -> Start, End
series = Series(Start=0, Step=1, Count=lng)
merge = Merge(Data1=graft(end.Start), Data2=graft(end.End))
int = Integer(series)
python = PythonScript(
    Code=file,
    Curve=crv_2,
    Reverse=reversesection,
    Directory="D:\\test\",
    Name="name",
    Reset=reset,
    Next=nextsection,
    Draw=startdraw,
    Redo=redo,
    Mark=marksize)  # -> Out, Preview
panel = Panel(python.Out)
tag = TextTag3D(Location=merge, Text=graft(int), Size=Slider(1, range=0..10), Justification=7)
